# Grasshopper definition 0-101010 SAP-Simple-Create structural finite element mesh.gh (Grasshopper 1.0.7)
# plug-ins: ggRhinoSAP

polygon = Polygon(Plane=PlaneXY(0, 0, 0), Radius=7, Segments=Slider(5, range=3..9), FilletRadius=0)  # -> Polygon, Length
custom_mesh_settings = SettingsCustom(
    StitchSeams=True,
    SimplePlanes=False,
    Refine=True,
    MinCount=16,
    MaxCount=400,
    AspectRatio=2,
    MaxDistance=0,
    MaxAngle=20,
    MinEdge=0.3,
    MaxEdge=1)
disc = Discontinuity(Curve=polygon.Polygon, Level=1)  # -> Points, Parameters
planar = PlanarSrf(Edges=polygon.Polygon)
mesh = MeshBrep(BRep=planar, Settings=custom_mesh_settings)
ssibake = SsiSAPBakeStructure(ClipSummary=False, NewFile=True, TagReplace=True, Units="N_m_C")
ssinode = SsiSAPCreateOrFindNode(Point=disc.Points, NodeRestraint="RRRFFF")
ggconc = GgSAPCreateConcrete(StandardStructureConcrete="EN_C35_NORMALWEIGHT")
ggap = GgSAPCreateShellProp(Name="PROP 1", Thickness="0.2", Material=ggconc, ShellType=1, MaterialAngle=0, DrillingDegreesOfFreedom=True)
ggmfe = GgSAPMeshConvertFiniteElements(Prop=ggap, Mesh=mesh)  # -> StructureModelAreas, StructureModelNodes, MeshIdentifyingFacesBreachingShapeChecks
