# Grasshopper definition 140820 Etabs-Simple-Create Frame Element.gh (Grasshopper 0.9.75)

ggetabscreate_elastic_isotropic_material = GgETABSCreateElasticIsotropicMaterial(
    Name="MyMaterial",
    ElasticModulusPa=2.05e+11,
    PoissonsRatio=0.3,
    ShearModulusPa=0,
    Density=7850,
    CoefficientOfThermalExpansion=1.2e-05,
    DampingRatio=0)
ggcatalogueprofile = GgCatalogueProfile(Region="Australian", Serial="610UB125", Type="Universal Beams")
boolean_toggle = BooleanToggle(True)
construct_point = ConstructPoint(XCoordinate=0, YCoordinate=0, ZCoordinate=0)
ggetabspointrestraint = GgETABSPointRestraint(
    RestraintX=boolean_toggle,
    RestraintY=boolean_toggle,
    RestraintZ=boolean_toggle,
    RestraintXX=False,
    RestraintYY=False,
    RestraintZZ=False)
ggetabscreateframeprop = GgETABSCreateFrameProp(Profile=ggcatalogueprofile, Name="MyProp", Material=ggetabscreate_elastic_isotropic_material)
line_sdl = LineSDL(Start=construct_point, Direction=Vector(1, 0, 0), Length="2000")
ggetabspointatts = GgETABSPointAtts(
    Restraint=ggetabspointrestraint,
    LocalAxis=Plane(origin=(-1.234321012e+308, -1.234321012e+308, -1.234321012e+308), x=(-1.234321012e+308, -1.234321012e+308, -1.234321012e+308), y=(-1.234321012e+308, -1.234321012e+308, -1.234321012e+308)),
    LowNodeID=1,
    MergeNumber=0)
ggetabscreateframe = GgETABSCreateFrame(
    Prop=ggetabscreateframeprop,
    NodeCL=line_sdl,
    Angle=0,
    ggETABS_ssiIds="2251b3ce-de87-4ef6-abbe-eb4cefd1632e;c5e9007c-1b34-4c76-9f52-eed8c13d3f5b")
ggetabscreateorfindpoint = GgETABSCreateOrFindPoint(Location=construct_point, Atts=ggetabspointatts, DetectTol=0)
ggetabsbakemodel = GgETABSBakeModel(BakeAll=False, ClipSummary=False, NewFile=False, SecProps=True, TagReplace=True, Units="kN_m_C")
