# Grasshopper definition 170510 Etabs-Simple-Create Frame with Orientation.gh (Grasshopper 0.9.76)
# plug-ins: BullAnt, ggGHAKarambaEtabs, ggETABS, ggRhinoIFC

point = Point([Point(-3060.092402, 112.3692804, 0), Point(-212.2214869, 5536.243847, 0), Point(4644.565333, -255.5873105, 0), Point(107.7305592, -3045.088443, 0), Point(164.9138186, -680.9901863, 0)])
panel = Panel("3000")
interpolate = Interpolate(Vertices=point, Degree=3, Periodic=Toggle(True), KnotStyle=1)  # -> Curve, Length, Domain
ggetabscreate_elastic_isotropic_material = GgETABSCreateElasticIsotropicMaterial(
    Name="MySteel",
    ElasticModulusPa=2.05e+11,
    PoissonsRatio=0.3,
    ShearModulusPa=0,
    Density=7850,
    CoefficientOfThermalExpansion=1.2e-05,
    DampingRatio=0)
divide_curve = DivideCurve(Curve=interpolate.Curve, Count=Slider(22, range=0..100), Kinks=False)  # -> Points, Tangents, Parameters
ggcatalogueprofile = GgCatalogueProfile(Region="British", Serial="UC152x152x30", Type="Universal Columns")
distance = Distance(PointA=divide_curve.Points, PointB=Point(0, 0, 0))
shatter = Shatter(Curve=interpolate.Curve, Parameters=divide_curve.Parameters)
ggetabscreate_elastic_isotropic_material_2 = GgETABSCreateElasticIsotropicMaterial(
    Name="MyConcrete",
    ElasticModulusPa=2.05e+11,
    PoissonsRatio=0.3,
    ShearModulusPa=0,
    Density=7850,
    CoefficientOfThermalExpansion=1.2e-05,
    DampingRatio=0)
line_sdl = LineSDL(Start=divide_curve.Points, Direction=Vector(0, 0, 1), Length=distance)
ggetabscreateframeprop = GgETABSCreateFrameProp(Profile=ggcatalogueprofile, Name=ggcatalogueprofile, Material=ggetabscreate_elastic_isotropic_material)
curve = Curve(shatter)
ggconvcurve = GgConvCurve(Curve=curve, Tol=Slider(10, range=0..10), AngleTolerance=0.01745329252, Polyline=True)  # -> Curve, Simplified
join_curves = JoinCurves(Curves=ggconvcurve.Curve, Preserve=False)
ggetabscreate_slab_prop = GgETABSCreateSlabProp(Name="200Concrete", Thickness="200", Material=ggetabscreate_elastic_isotropic_material_2, ShellType=2)
ggetabscreateframe = GgETABSCreateFrame(Prop=ggetabscreateframeprop, NodeCL=line_sdl, Orientation=divide_curve.Tangents, Angle=0, ShellType=10)
ggetabscreateareaperimeter = GgETABSCreateAreaPerimeter(Prop=ggetabscreate_slab_prop, Perimeter=join_curves)  # -> StructureArea, StructureModelNodes
ggetabsbakemodel = GgETABSBakeModel(ClipSummary=False, NewFile=False, TagReplace=True, Units="kN_m_C")
ggifc_readfile = GgIFCReadFile(AppendData=True)  # -> IfcProject, IfcMaterials, IfcTypeObjects
ggkarambatoetabs = GgKarambaToEtabs(Enabled=False, Independent=True)
