# Grasshopper definition 0-110516-gsa-intermediate-non-linear-form-finding-of-mesh-surface.gh (Grasshopper 1.0.7)
# plug-ins: BullAnt, ggGHgsa

gggsacreate_material = GgGSACreateMaterial(StandardStructureMaterial=0)
pt = Point(Point(11336, -1769, 0))
pt_2 = Point(Point(10784, 7312, 0))
pt_3 = Point(Point(-113, -64, 0))
pt_4 = Point(Point(9479, 4603, 0))
pt_5 = Point(Point(3509, 2094, 0))
circle = CircleCNR(Center=pt_4, Normal=Vector(0, 0, 1), Radius=750)
circle_2 = CircleCNR(Center=pt_5, Normal=Vector(0, 0, 1), Radius=750)
rec_3pt = Rectangle3Pt(PointA=pt_3, PointB=pt, PointC=pt_2)  # -> Rec, Length
planar = PlanarSrf(Edges=[rec_3pt.Rec, circle_2, circle])
crv = Curve(circle)
crv_2 = Curve(circle_2)
crv_3 = Curve(rec_3pt.Rec)
custom_mesh_settings = SettingsCustom(
    StitchSeams=True,
    SimplePlanes=False,
    Refine=True,
    MinCount=16,
    MaxCount=400,
    AspectRatio=1.2,
    MaxDistance=0,
    MaxAngle=20,
    MinEdge=0,
    MaxEdge=500)
gggsacreate_2d_finite_element_prop = GgGSACreate2dFiniteElementProp(Name="my2DProp", Thickness=Slider(30, range=0..100), Material=gggsacreate_material)
mesh = MeshBrep(Brep=planar, Settings=custom_mesh_settings)
gggsanodeatts = GgGSANodeAtts(Restraint="RRRFFF", LowNodeID=1)
gggsaloadcase = GgGSALoadCase(Name="Form Find", ID=1, LoadCaseType="UNDEF", Bridge=False)
gggsameshconvertfiniteelements = GgGSAMeshConvertFiniteElements(Prop=gggsacreate_2d_finite_element_prop, Mesh=mesh, Angle=0, QuadShapeCheckAcceptance=0)  # -> StructureModelFiniteElements, StructureModelNodes, MeshIdentifyingFacesBreachingShapeChecks
mcomp = Decompose(Mesh=mesh)  # -> Vertices, Faces, Colours, Normals
gggsaanalysis_nonlinear_static = GgGSAAnalysisNonLinearStatic(
    Name="GSA Relax Form Find",
    ID=0,
    MaxCycles=10000,
    RelativeResidual=True,
    ForceResidual=0.001,
    MomentResidual=0.001,
    Slenderness=True)
ggpp = GeometryGymProximityPoints(Geometry=crv_3, Points=gggsameshconvertfiniteelements.StructureModelNodes, Proximity=50)
ggpp_2 = GeometryGymProximityPoints(Geometry=crv, Points=gggsameshconvertfiniteelements.StructureModelNodes, Proximity="20")
ggpp_3 = GeometryGymProximityPoints(Geometry=crv_2, Points=gggsameshconvertfiniteelements.StructureModelNodes, Proximity="20")
gggsacreateorfindnode = GgGSACreateOrFindNode(Location=ggpp_2, Atts=gggsanodeatts, DetectTol="0")
gggsacreateorfindnode_2 = GgGSACreateOrFindNode(Location=ggpp_3, Atts=gggsanodeatts, DetectTol="0")
gggsacreateorfindnode_3 = GgGSACreateOrFindNode(Location=ggpp, Atts=gggsanodeatts, DetectTol=0)
gggsaquery_node_displacement = GgGSAQueryNodeDisplacement(Nodes=flatten(gggsameshconvertfiniteelements.StructureModelNodes), Case=gggsaloadcase)
int = Integer(1000)
gggsacreatelist = GgGSACreateList(StructObj=flatten(gggsacreateorfindnode), Name="Internal Perim2", IncrementSuffixStart=-1)
gggsasolver = GgGSASolver(
    Enabled=Toggle(False),
    NewModel=True,
    CloseModel=True,
    AnalsysTasks=flatten(gggsaanalysis_nonlinear_static),
    ResultQueries=flatten(gggsaquery_node_displacement))
gggsacreatelist_2 = GgGSACreateList(StructObj=flatten(gggsacreateorfindnode_2), Name="Internal Perim", IncrementSuffixStart=-1)
Z = UnitZ(Factor=int)
Z_2 = UnitZ(Factor=expr("-x", int))
gggsaresult_node_set_decompose = GgGSAResultNodeSetDecompose(SetResultsNode=gggsasolver)  # -> NodeIDs, Case, Result, Unit, ResultAsVector, Max, Min
gggsaloadnodesettlement = GgGSALoadNodeSettlement(
    LoadCase=gggsaloadcase,
    RestrainedNodeOrListOfNodes=gggsacreatelist,
    VectorRepresentingSettlementDirectionAndMagnitude=Z_2)
gggsaloadnodesettlement_2 = GgGSALoadNodeSettlement(
    LoadCase=gggsaloadcase,
    RestrainedNodeOrListOfNodes=gggsacreatelist_2,
    VectorRepresentingSettlementDirectionAndMagnitude=Z)
gggsabakemodel = GgGSABakeModel(ClipSummary=False, NewFile=True)
addition = Addition(A=mcomp.Vertices, B=gggsaresult_node_set_decompose.ResultAsVector)
mesh_2 = Mesh(Vertices=addition, Faces=mcomp.Faces)
