# Grasshopper definition 0-120418-gsa-simple-generate-perimeter-beams-not-working-this-is-a-placeholder.gh (Grasshopper 1.0.7)
# plug-ins: ggGHgsa

slider = Slider(10, range=0..10)
pt = Point([Point(-124, 207, 0), Point(185, 138, 0), Point(135, -381, 0), Point(18, -164, 0), Point(-75, -407, 0)])
pt_2 = Point([Point(727, -737, 0), Point(3602, 1497, 0), Point(4553, 4298, 0), Point(1833, 6242, 0)])
range = Range(Domain=Domain(0, 1), Steps=slider)
pline = PolyLine(Vertices=pt, Closed=True)
intcrv = Interpolate(Vertices=pt_2, Degree=3, Periodic=False)  # -> Curve, Length, Domain
graph = GraphMapper(
    range,
    x0=0,
    x1=1,
    y0=0,
    y1=1,
    container_name="Bezier",
    cpx=[0, 0.1884057969, 0.6304348111, 1],
    cpy=[0.1304347813, 0.9057971239, 0.297101438, 1])
divide = DivideCurve(Curve=intcrv.Curve, Count=slider, Kinks=False)  # -> Points, Tangents, Parameters
Z = UnitZ(Factor=1)
xprod = CrossProduct(VectorA=divide.Tangents, VectorB=Z, Unitize=True)  # -> Vector, Length
scale = Scale(Geometry=pline, Center=Point(0, 0, 0), Factor=graph)  # -> Geometry, Transform
pl = Plane(Origin=divide.Points, XAxis=xprod.Vector, YAxis=Z)
orient = Orient(Geometry=scale.Geometry, Source=PlaneXY(0, 0, 0), Target=pl)  # -> Geometry, Transform
ssibake = SsiGSABakeStructure(ClipSummary=False, NewFile=True)
ssipb = SsiGSAGeneratePerimBeams(PathCurve=intcrv.Curve, NumberOfSegments=5, ToleranceForGeometryDetection=5)  # -> StructureModelBeam, StructureSections, StructureNodes
data = Data(ssipb.StructureModelBeam)
panel = Panel(ssipb.StructureSections)
