# Grasshopper definition 0-120713-gsa-simple-defining-a-load-case-combination.gh (Grasshopper 1.0.7)
# plug-ins: ggGHgsa

gglc = GgGSALoadCase(Name="Prestress", ID=2, LoadCaseType="DEAD", Bridge=False)
gglc_2 = GgGSALoadCase(Name="SelfWeight", ID=1, LoadCaseType="DEAD", Bridge=False)
ggcc = GgGSACaseCombination(Name="CaseCombo", ID=1, CasesOrCombinationString=[gglc_2, gglc])
ggbake = GgGSABakeStructure(ClipSummary=False, NewFile=True)
