# Grasshopper definition 0-120914-gsa-simple-implementing-a-structural-joint.gh (Grasshopper 1.0.7)
# plug-ins: BullAnt, ggGHgsa

ggna = GgGSANodeAtts(Restraint="RRRRRR", LowNodeID=1)
pt = Point(Point(0, 0, 0))
pt_2 = Point(Point(4000, 0, 0))
pt_3 = Point(Point(5000, 0, 0))
ggnode = GgGSACreateOrFindNode(Location=pt, Atts=ggna, ToleranceForDetectionOfExistingNodes=0)
ggnode_2 = GgGSACreateOrFindNode(Location=pt_2, ToleranceForDetectionOfExistingNodes=0)
ggnode_3 = GgGSACreateOrFindNode(Location=pt_3, Atts=ggna, ToleranceForDetectionOfExistingNodes=0)
sdrcp = SdrCatalogueProfile(Region="British", Serial="UB254x102x22", Type="Universal Beams")
gglc = GgGSALoadCase(Name="SelfWeight", ID=1, LoadCaseType="UNDEF", Bridge=False)
ggmat = GgGSACreateMaterial(StandardStructureMaterial=0)
ggsp = GgGSACreateSectionProp(Profile=sdrcp, Name=sdrcp, Material=ggmat)
gggl = GgGSALoadGravity(LoadCase=gglc, XGravityFactor=0, YGravityFactor=0, ZGravityFactor=-1)
ggjoint = GgGSACreateJoint(MasterNode=ggnode_2, X=True, Y=True, Z=True, XX=True, YY=Toggle(False), ZZ=True)  # -> Joint, SlaveNode
ggbake = GgGSABakeStructure(ClipSummary=False, NewFile=True)
ggbeam = GgGSACreateBeam(Prop=ggsp, NodeCL=ggnode, Node2=ggnode_2, Angle=0)
ggbeam_2 = GgGSACreateBeam(Prop=ggsp, NodeCL=ggjoint.SlaveNode, Node2=ggnode_3, Angle=0)
