# Grasshopper definition 0-121204-gsa-simple-curve-point-load.gh (Grasshopper 1.0.7)
# plug-ins: BullAnt, ggGHgsa

ggcatalogueprofile = GgCatalogueProfile(Region="British", Serial="UB178x102x19", Type="Universal Beams")
gggsacreate_material = GgGSACreateMaterial(StandardStructureMaterial=0)
pt = Point([Point(-141.5496557, 283.368723, 0), Point(317.6924357, 283.368723, 0), Point(19.07606056, 515.0693129, 0), Point(118.7575137, -44.5132231, 0)])
ssinode = SsiGSACreateOrFindNode(Location=pt, ToleranceForDetectionOfExistingNodes=0)
item = ListItem(List=ssinode, Index=1, Wrap=False)
item_2 = ListItem(List=ssinode, Index=0, Wrap=False)
gggsacreatesectionprop = GgGSACreateSectionProp(Profile=ggcatalogueprofile, Name=ggcatalogueprofile, Material=gggsacreate_material)
gggsaloadcase = GgGSALoadCase(Name="MyLoadCase", ID=1, LoadCaseType="UNDEF", Bridge=False)
ssibeam = SsiGSACreateBeam(Prop=gggsacreatesectionprop, NodeCL=item_2, Node2=item, Angle=0)
gggsabakemodel = GgGSABakeModel(ClipSummary=False, NewFile=True)
gggsaloadcrvpoint = GgGSALoadCrvPoint(
    LoadCase=gggsaloadcase,
    LoadedElements=ssibeam,
    Position=-0.5,
    LoadIntensity="-5",
    Direction=0,
    Projected=False,
    LocalAxis=True,
    LoadUnits=1)
