# Grasshopper definition 0-130131-gsa-simple-transform-beam-element-mirror.gh (Grasshopper 1.0.7)
# plug-ins: BullAnt, ggGHgsa

sdrcp = SdrCatalogueProfile(Region="AISC Imperial", Serial="W5X19")
ggmat = GgGSACreateMaterial(StandardStructureMaterial=0)
Z = UnitZ(Factor=1)
rad = Radians(Degrees=Slider(31, range=0..100))
ggsp = GgGSACreateSectionProp(Profile=sdrcp, Name=sdrcp, Material=ggmat)
line = Line(Line((571.5062392, -250.9128845, 0), (1170.811431, 1613.244871, 0)))
vrot = Rotate(Vector=Z, Axis=Vector(0, 1, 0), Angle=rad)
ggbeam = GgGSACreateBeam(Prop=ggsp, NodeCL=line, Orientation=vrot, Angle=0)
mirror = Mirror(Plane=PlaneYZ(0, 0, 0))  # -> Geometry, Transform
ggtransform = GgGSATransformStructure(Transform=mirror.Transform, Structure=ggbeam, ElementID=1, NodeID=1, GroupID=0)
