# Grasshopper definition 0-130417-gsa-simple-uniform-load-on-panel.gh (Grasshopper 1.0.7)
# plug-ins: BullAnt, ggGHgsa

ggcp = GgCatalogueProfile(Region="EuroProfile", Serial="IPE140", Type="EP IPE Beams")
msphere = MeshSphere(Base=PlaneXY(0, 0, 0), Radius=10000, UCount=10, VCount=20)
ggmat = GgGSACreateMaterial(StandardStructureMaterial=0)
ggbake = GgGSABakeStructure(ClipSummary=False, NewFile=True)
medges = MeshEdges(Mesh=msphere)  # -> NakedEdges, InteriorEdges, NonManifoldEdges
ggsp = GgGSACreateSectionProp(Profile=ggcp, Name=ggcp, Material=ggmat)
gglp2d = GgGSACreate2dLoadPanelProp(Name="MyLoadPanel", ID=1, AreaSupportPattern="SUP_TWO", Edge=1)
ggbeam = GgGSACreateBeam(Prop=ggsp, NodeCL=medges.InteriorEdges, Angle=0)
ggmfe = GgGSAMeshConvertFiniteElements(Prop=gglp2d, Group=1, Mesh=msphere, Angle=0)  # -> StructureModelFiniteElements, StructureModelNodes, MeshIdentifyingFacesBreachingShapeChecks
gglc = GgGSALoadCase(Name="MyLoadCase", ID=1, LoadCaseType="UNDEF", Bridge=False)
ggfl = GgGSALoad2dFace(LoadCase=gglc, LoadedElements=gglp2d, LoadPressure="-2", Axis="Z", Projected=False, LocalAxis=False, PressureUnit=1)
