# Grasshopper definition 0-141204-revit-simple-adaptive-component-single-point.gh (Grasshopper 1.0.7)
# plug-ins: ggRhinoIFC

mesh_sphere = MeshSphere(Base=PlaneXY(0, 0, 0), Radius=2000, UCount=10, VCount=20)
ggrvt_archadaptcomptype = GgRvtArchAdaptCompType(Type=7, Name="MyAdaptiveFamilyPoint", ggIFC_ggIds="ab40d3ac-de38-45fb-8871-e29f28c8c20b;37cPkxlyr0xB5zAGmq$D3l")
deconstruct_mesh = DeconstructMesh(Mesh=mesh_sphere)  # -> graft(Vertices), Faces, Colours, Normals
ggrvt_baketofile = GgRvtBaketoFile(Format="STEP", IFC4=True, Radians=True, RepMapExport="NONE")
ggrvt_createadaptivecomponent = GgRvtCreateAdaptiveComponent(Family=ggrvt_archadaptcomptype, Polyline=deconstruct_mesh.Vertices, ggIFC_ggIds="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")
