# Grasshopper definition 0-150212-revit-simple-defining-a-composite-wall.gh (Grasshopper 1.0.7)
# plug-ins: ggRhinoIFC

ggrvt_material = GgRvtMaterial(Name="Plaster", Class=15)
ggrvt_material_2 = GgRvtMaterial(Name="Concrete", Class=15)
ggrvt_materiallayer = GgRvtMaterialLayer(RvtMaterial=ggrvt_material, Thickness="10", Function=3, Wraps=True, Structural=False, Variable=False)
ggrvt_materiallayer_2 = GgRvtMaterialLayer(RvtMaterial=ggrvt_material_2, Thickness="200", Function=0, Wraps=True, Structural=True, Variable=False)
line = Line(Line((-20, -75, 0), (5597, 10463, 0)))
ggrvt_walltype = GgRvtWallType(
    Name="Composite",
    LayersAboveCore=ggrvt_materiallayer,
    LayersCore=ggrvt_materiallayer_2,
    LayersBelowCore=ggrvt_materiallayer,
    Interior=True,
    ggIFC_ggIds="4fe8ed3c-d095-4deb-8ef5-a77e3318dad6;2sl19MiYH9kwt8MKoNodxN")
ggrvt_baketofile = GgRvtBaketoFile(Format="STEP", IFC4=True, Radians=True, RepMapExport="NONE")
ggifc_wall = GgIFCWall(
    RvtWallType=ggrvt_walltype,
    Offset=0,
    PositiveDirection=False,
    PathOrPerimeter=line,
    WallHeight="3250",
    ggIFC_ggIds="55309101-77fe-43de-b4eb-b953618fc101;2PX0CHclj19PZ0iUQ1muk1")
