# Grasshopper definition 0-150616-revit-simple-nurbs-object-into-revit.gh (Grasshopper 1.0.7)
# plug-ins: ggRhinoIFC

rectangle = Rectangle(Plane=PlaneXY(0, 0, 0), XSize=Domain(-100, 100), YSize=Domain(-200, 200), Radius=0)  # -> Rectangle, Length
rotate = Rotate(Geometry=rectangle.Rectangle, Angle=1.570796327, Plane=PlaneXY(0, 0, 0))  # -> Geometry, Transform
move = Move(Geometry=rotate.Geometry, Motion=Vector(0, 0, 2000))  # -> Geometry, Transform
loft = Loft(
    Curves=[rectangle.Rectangle, move.Geometry],
    Options={Adjust=False, Closed=False, LoftEnds=0, LoftSimp=0, LoftType=0, Rebuild=10, Refit=0.01})
cap_holes = CapHoles(Brep=loft)
ggrvt_archgenericmodelfamily = GgRvtArchGenericModelFamily(
    Type=8,
    Name="MyNurbsObject",
    Geometry=cap_holes,
    ggIFC_ggIds="a16dfcd8-11fb-42e3-99d1-1d875cb9ad5c;0Wp84d6bT8v8FQ8XEr21Wc")
ggrvt_booleanparameter = GgRvtBooleanParameter(Name="IsNurbs", Boolean=Toggle(True))
ggrvt_baketofile = GgRvtBaketoFile(Format="STEP", IFC4=True, Radians=True, RepMapExport="SAT")
ggrvt_create_instance = GgRvtCreateInstance(
    Family=ggrvt_archgenericmodelfamily,
    Location=PlaneXY(0, 0, 0),
    Parameters=ggrvt_booleanparameter,
    ggIFC_ggIds="41bf3392-807d-4fa1-8ec1-101091e494a8;1cB0XU8lv7kv5UXt1u9m9k")
