# Grasshopper definition 0-150831-revit-simple-understanding-wall-alignment.gh (Grasshopper 1.0.7)
# plug-ins: ggRhinoIFC

panel = Panel("""-5000
5000""")
ggrvt_material = GgRvtMaterial(Name="concrete", Class=15)
construct_point = ConstructPoint(XCoordinate=panel, YCoordinate="4000", ZCoordinate=0)
rectangle = Rectangle(Plane=PlaneXY(0, 0, 0), XSize=Domain(-5000, 5000), YSize=Domain(0, 3000), Radius=0)  # -> Rectangle, Length
line_sdl = LineSDL(Start=construct_point, Direction=Vector(0, -1, 0), Length="5000")
ggrvt_materiallayer = GgRvtMaterialLayer(RvtMaterial=ggrvt_material, Thickness="200", Function=0, Wraps=True, Structural=True, Variable=False)
panel_2 = Panel("""A
B""")
explode = Explode(Curve=rectangle.Rectangle, Recursive=True)  # -> Segments, Vertices
ggifc_grid = GgIFCGrid(GridName=panel_2, Curve=line_sdl, ggIFC_ggIds="8a60b76e-b29b-42b4-acb2-7ec4d5c8d926;2a5RbfvTP6Sw5T4yl$$JSm")
ggrvt_walltype = GgRvtWallType(
    Name="MyWall",
    LayersCore=ggrvt_materiallayer,
    Interior=True,
    ggIFC_ggIds="45cbe92d-9f83-45a2-8b39-c4b583b8881c;1Yp2yOionFlRYZXFtSC14r")
panel_3 = Panel("""0
3000""")
construct_point_2 = ConstructPoint(XCoordinate="-5500", YCoordinate=panel_3, ZCoordinate=0)
ggrvt_wall = GgRvtWall(
    RvtWallType=ggrvt_walltype,
    Offset=0,
    PositiveDirection=False,
    PathOrPerimeter=explode.Segments,
    WallHeight="3500",
    ggIFC_ggIds="2161e507-4fcf-49f4-ab9f-be4cfeb573b4;3lvjZaDVrEtv9Wh1dJLbvH;1EKqAomrvBHw4WBVqNiJDD;11HHrb9IzFFg5zx65gn6xg;1tvB3YIvT8Dh$cHdfsh5rO")
line_sdl_2 = LineSDL(Start=construct_point_2, Direction=Vector(1, 0, 0), Length="11000")
panel_4 = Panel("""1
2""")
ggrvt_baketofile = GgRvtBaketoFile(Format="STEP", IFC4=True, Radians=True, RepMapExport="NONE")
ggifc_grid_2 = GgIFCGrid(GridName=panel_4, Curve=line_sdl_2)
