# Grasshopper definition 0-180604-gsa-intermediate-form-finding-using-soap-film-of-fabric-canopy-structure-use-as-online-test.gh (Grasshopper 1.0.7)
# plug-ins: BullAnt, ggGHgsa

width = Slider(5000, range=5000..20000)
Z = Slider(2000, range=2000..7000)
division = Division(A=width, B=2)
division_2 = Division(A=width, B=-2)
# Assumes Rhino Document to have Millimetres as Unit
# Jon Mirtschin, Geometry Gym Ltd
# Model Derived from Pete Debney Oasys Webinar
# http://www.oasys-software.com/support/events/webinars/form_finding_with_gsa.shtml
# Requires ggRhinoGSA andBullAnt from http://www.geometrygym.com/downloads
back_stay = Slider(2000, range=2000..7000)
construct_domain = Domain(DomainStart=division_2, DomainEnd=division)
construct_point = PointXYZ(XCoordinate=division_2, YCoordinate=division_2, ZCoordinate=0)
construct_point_2 = PointXYZ(XCoordinate=division, YCoordinate=division, ZCoordinate=0)
range = Range(Domain=construct_domain, Steps=Slider(10, range=2..20))
vector_xyz = VectorXYZ(XComponent=back_stay, YComponent=back_stay, ZComponent=0)  # -> Vector, Length
construct_point_3 = PointXYZ(XCoordinate=division, YCoordinate=division, ZCoordinate=Z)
construct_point_4 = PointXYZ(XCoordinate=division_2, YCoordinate=division_2, ZCoordinate=Z)
construct_point_5 = PointXYZ(XCoordinate=range, YCoordinate=division_2, ZCoordinate=Z)
construct_point_6 = PointXYZ(XCoordinate=division_2, YCoordinate=range, ZCoordinate=Z)
construct_point_7 = PointXYZ(XCoordinate=division, YCoordinate=range, ZCoordinate=Z)
construct_point_8 = PointXYZ(XCoordinate=range, YCoordinate=division, ZCoordinate=Z)
ssifm = SsiGSACreateFabricMaterial(
    Name="Fabric",
    ID=1,
    FabricWarpModulusNM=800000,
    FabricWeftModulusNM=400000,
    PoissonsRatio=0.45,
    ShearModulusNM=30000,
    Compression=False)
line = Line(StartPoint=construct_point_5, EndPoint=construct_point_8)
line_2 = Line(StartPoint=construct_point_6, EndPoint=construct_point_7)
construct_point_9 = PointXYZ(XCoordinate=[division_2, division], YCoordinate=[division, division_2], ZCoordinate=Z)
unit_z = UnitZ(Factor=Z)
ssina = SsiGSANodeAtts(Restraint="RRRFFF", LowNodeID=1)
ssina_2 = SsiGSANodeAtts(Restraint="RRRFFR", LowNodeID=1)
addition = Addition(A=construct_point_2, B=vector_xyz.Vector)
subtraction = Subtraction(A=construct_point, B=vector_xyz.Vector)
sdrcs = SdrCurvesSplitIntersect(Curves=[line, line_2], SplitPoly=False)
ssipf = SsiGSACreateFabricProperty(Name="Fabric", Id=1, Material=ssifm, GlobalAxis=True, AdditionalMass=0, InPlaneThicknessPercentage=100)
sdrcnm = SdrNetworkToMesh(Curves=flatten(sdrcs))
param_viewer = ParamViewer(sdrcs)
ssinode = SsiGSACreateOrFindNode(Location=[construct_point, construct_point_2], Atts=ssina_2, ToleranceForDetectionOfExistingNodes=-1)
ssinode_2 = SsiGSACreateOrFindNode(Location=[addition, subtraction], Atts=ssina, ToleranceForDetectionOfExistingNodes=-1)
ssibake = SsiGSABakeStructure(ClipSummary=False, NewFile=False)
ssimat = SsiGSACreateMaterial(StandardStructureMaterial=0)
list_length = ListLength(List=param_viewer)
series = Series(Start=1, Step=1, Count=list_length)
boolean = Boolean(False)
division_3 = Division(A=list_length, B=2)
sdrchs = SdrGenerateCHS(Diameter=10)
integer = Integer(0)
boolean_2 = Boolean(series)
subtraction_2 = Subtraction(A=list_length, B=1)
subtraction_3 = Subtraction(A=division_3, B=1)
ssiss2 = SsiGSACreateSoapStress2D(Property2dElement=ssipf, StressX=1, StressY=1)
# Fabric Elements
ssimfe = SsiGSAMeshConvertFiniteElements(Prop=ssipf, Group=1, Mesh=sdrcnm, Tolerance=-1)  # -> StructureModelFiniteElements, StructureModelNodes
ssinode_3 = SsiGSACreateOrFindNode(Location=construct_point_9, Atts=ssina, ToleranceForDetectionOfExistingNodes=-1)
line_3 = Line(StartPoint=[subtraction, addition], EndPoint=[construct_point_4, construct_point_3])
replace_items = ListReplace(List=boolean_2, Item=boolean, Indices=[integer, subtraction_3, division_3, subtraction_2], Wrap=False)
dispatch = Dispatch(List=series, DispatchPattern=replace_items)  # -> ListA, ListB
dispatch_2 = Dispatch(List=param_viewer, DispatchPattern=replace_items)  # -> ListA, ListB
# Back Stays
panel = Panel("Back Stay")
line_sdl = LineSDL(Start=[construct_point, construct_point_2], Direction=unit_z, Length=Z)
ssispacerprop = SsiGSACreateSpacerProp(PropertyID=dispatch.ListA, Axis=0, SpacerType="GEODESIC", SpacerLengthType="RATIO", Stiffness=1, Ratio=1)  # -> simplify(graft(StructurePropertySpacer))
gggsaloadcase = GgGSALoadCase(Name="Settlement", ID=1, LoadCaseType="UNDEF", Bridge=False)
ssisp = SsiGSACreateSectionProp(Profile="CAT EN-CHS CHS102x3.2", Name="Post", Material=ssimat, LowPropID=1)
ssisp_2 = SsiGSACreateSectionProp(Profile=sdrchs, Name=panel, Material=ssimat, LowPropID=1)
gggsacreatelist = GgGSACreateList(StructObj=flatten(ssinode_3), Name="Displaced Nodes", IncrementSuffixStart=-1)
tree_branch = TreeBranch(Tree=sdrcs, Path=dispatch_2.ListA, MaintainPaths=False)
ssisp_3 = SsiGSACreateSectionProp(Profile=sdrchs, Name="Edge Ties", Material=ssimat, LowPropID=1)
tree_branch_2 = TreeBranch(Tree=sdrcs, Path=dispatch_2.ListB, MaintainPaths=False)
ssiba = SsiGSABeamAtts(ReleaseA="FFFFFF", ReleaseB="FFFFFF", CoincidentNodeTol=0, BeamType="SPACER")
ssifd1 = SsiGSACreateForceDensity1D(SectionProperty=ssisp_2, ForceDensity=20)
ssibeam = SsiGSACreateBeam(Prop=ssisp_2, NodeCL=line_3)
# Posts
ssibeam_2 = SsiGSACreateBeam(Prop=ssisp, NodeCL=line_sdl)
gggsaloadnodesettlement = GgGSALoadNodeSettlement(
    LoadCase=gggsaloadcase,
    RestrainedNodeOrListOfNodes=gggsacreatelist,
    VectorRepresentingSettlementDirectionAndMagnitude=unit_z)
# Edge Tie
ssifd1_2 = SsiGSACreateForceDensity1D(SectionProperty=ssisp_3, ForceDensity=10)
ssibeam_3 = SsiGSACreateBeam(Prop=ssisp_3, NodeCL=tree_branch_2)
ssibeam_4 = SsiGSACreateBeam(Prop=ssispacerprop, NodeCL=tree_branch, BeamAtts=ssiba)
# Geodesic Spacer Generation
ssispacerprop_2 = SsiGSACreateSpacerProp(PropertyID=dispatch.ListB, Axis=0, SpacerType="BAR", SpacerLengthType="RATIO", Stiffness=1, Ratio=1)  # -> simplify(graft(StructurePropertySpacer))
panel_2 = Panel(ssispacerprop)
# Bar Spacer Generation
ssibeam_5 = SsiGSACreateBeam(Prop=ssispacerprop_2, NodeCL=tree_branch_2, BeamAtts=ssiba)
integer_2 = Integer(1)
gggsaanalysis_form_find = GgGSAAnalysisFormFind(
    Name="form find task",
    ID=integer_2,
    SaveSpacerForce=0,
    MaxCycles=10000,
    RelativeResidual=True,
    ForceResidual=0.001,
    MomentResidual=0.001,
    SaveElemForce=False,
    SaveSpacerForce_2=2)
gggsaanalysis_case = GgGSAAnalysisCase(Name="form find analysis case", ID=integer_2, StructAnalysisTask=gggsaanalysis_form_find, StructLoadCase=gggsaloadcase)
# Form Finding Task, Soap Film Properties Type
boolean_toggle = BooleanToggle(False)
gggsamodel_decompose = GgGSAModelDecompose(ActiveToggle=True)  # -> ModelSummary, Nodes, CurveElements, AreaElements, Material, SectionProperties, AreaProperties, AnalysisCases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
gggsaformfinding = GgGSAFormFinding(Enabled=boolean_toggle, NewModel=True, CloseModel=True, FormFindingTask=gggsaanalysis_form_find)  # -> FormFoundNodeLocations, FormFoundPrestressActions, Results
gggsabakemodel = GgGSABakeModel(ClipSummary=False, NewFile=False)
gggsadecomposebeam = GgGSADecomposeBeam(StructureModelBeam=gggsamodel_decompose.CurveElements)  # -> Prop, Axis, NodeA, NodeB, Orientation, Name, Id
list_item = ListItem(List=gggsaformfinding.FormFoundNodeLocations, Index=gggsadecomposebeam.NodeA, Wrap=True)
list_item_2 = ListItem(List=gggsaformfinding.FormFoundNodeLocations, Index=gggsadecomposebeam.NodeB, Wrap=True)
line_4 = Line(StartPoint=list_item, EndPoint=list_item_2)
ggnetworktomesh = GgNetworkToMesh(Curves=line_4)
