# Grasshopper definition 160324 Etabs-Intermediate-Building Tower Example.gh (Grasshopper 1.0.7)
# plug-ins: BullAnt, ggETABS

multiplication = Multiplication(A="2000", B=-1)
construct_domain = ConstructDomain(DomainStart=multiplication, DomainEnd="2000")
# Floor to Floor
panel = Panel("3250")
ggetabscreate_elastic_isotropic_material = GgETABSCreateElasticIsotropicMaterial(
    Name="Concrete",
    ElasticModulusPa=2e+10,
    PoissonsRatio=0.3,
    ShearModulusPa=0,
    Density=2500,
    CoefficientOfThermalExpansion=1.2e-05,
    DampingRatio=0)
# Number of Floors
slider = Slider(43, range=0..100)
division = Division(A=1, B=slider)
# Assumes Rhino Document to have millimetres as Unit
series = Series(Start=0, Step=1, Count=slider)
int = Integer(series)
concat = Concatenate(Start="Level ", End=int)
multiplication_2 = Multiplication(A=series, B=panel)
series_2 = Series(Start=0, Step=division, Count=slider)
graph = GraphMapper(
    series_2,
    x0=0,
    x1=1,
    y0=0,
    y1=1,
    container_name="Bezier",
    cpx=[0, 0.702898562, 0.1434783936, 1],
    cpy=[0.8623188138, 0.2246376872, 0.3507243693, 0.7681159377])
# Plate Radius
# Stories
panel_2 = Panel("Generic 200mm")
# Jon Mirtschin, Geometry Gym Pty Ltd
# Requires ggRhinoETABS from http://www.geometrygym.com/downloads
# Plate Offset
graph_2 = GraphMapper(
    series_2,
    x0=0,
    x1=1,
    y0=0,
    y1=1,
    container_name="Bezier",
    cpx=[0, 0.4565217495, 0.6702896357, 1],
    cpy=[0.4456523955, 0.4492753744, 0.7355076671, 0.02753614262])
ggetabscreate_wall_prop = GgETABSCreateWallProp(Name="Generic 300mm Wall", Thickness="300", Material=ggetabscreate_elastic_isotropic_material, ShellType=2)
multiplication_3 = Multiplication(A="10000", B=-1)
construct_point = ConstructPoint(XCoordinate=["10000", multiplication_3], YCoordinate=0, ZCoordinate=graft(multiplication_2))
rectangle = Rectangle(Plane=construct_point, XSize=construct_domain, YSize=construct_domain, Radius=0)  # -> simplify(Rectangle), Length
explode = Explode(Curve=rectangle.Rectangle, Recursive=True)  # -> Segments, Vertices
multiplication_4 = Multiplication(A="15000", B=graph)
# Slab Property
ggetabscreate_slab_prop = GgETABSCreateSlabProp(Name=panel_2, Thickness="200", Material=ggetabscreate_elastic_isotropic_material, ShellType=2)
multiplication_5 = Multiplication(A=graph_2, B="10000")
addition = Addition(A="4000", B=multiplication_5)
path_mapper = PathMapper(explode.Segments, source="{A;B}", target="{A}")
unit_z = UnitZ(Factor=panel)
pt = PointXYZ(XComponent=addition, YComponent=0, ZComponent=multiplication_2, System=PlaneXY(0, 0, 0))
ggetabscreatebuildingstorey = GgETABSCreateBuildingStorey(Name=concat, Elevation=multiplication_2)
cir = Circle(Plane=pt, Radius=multiplication_4)  # -> simplify(graft(Circle))
yz = YZPlane(Origin=Point(0, 0, 0))
mirror = Mirror(Geometry=cir, Plane=yz)  # -> simplify(graft(Geometry)), Transform
extrude = Extrude(Base=path_mapper, Direction=unit_z)
crv = Curve([cir, mirror.Geometry])
planar = PlanarSrf(Edges=crv)
sunion = SolidUnion(Breps=planar)
edges = BrepEdges(Brep=sunion)  # -> Naked, Interior, NonManifold
join = JoinCurves(Curves=edges.Naked, Preserve=False)  # -> simplify(Curves)
ggconvcurve = GgConvCurve(Curve=join, Tol=100, AngleTolerance=0.01745329252, Polyline=True)  # -> Curve, Simplified
# Slabs
curve_to_polyline = CurveToPolyline(Curve=join, ToleranceDistance=200, ToleranceAngle=0, MinEdge=0)  # -> Polyline, Segments
path_mapper_2 = PathMapper(curve_to_polyline.Polyline, source="{A;B}", target="{A}")
explode_2 = Explode(Curve=curve_to_polyline.Polyline, Recursive=True)  # -> Segments, Vertices
ggetabscreatearea = GgETABSCreateArea(Prop=ggetabscreate_slab_prop, Perimeter=path_mapper_2)  # -> StructureAreaProperty, StructureModelNodes
ggetabscreatearea_2 = GgETABSCreateArea(Prop=ggetabscreate_wall_prop, Perimeter=extrude)  # -> StructureAreaProperty, StructureModelNodes
gggeneraterhs = GgGenerateRHS(Depth="400")
unit_z_2 = UnitZ(Factor=multiplication_2)
panel_3 = Panel(explode_2.Segments)
ggetabscreateframeprop = GgETABSCreateFrameProp(Profile=gggeneraterhs, Name="400sq", Material=ggetabscreate_elastic_isotropic_material)
point = Point(Point(-5644.369292, 6270.502742, 0))
move = Move(Geometry=point, Motion=unit_z_2)  # -> Geometry, Transform
shift_list = ShiftList(List=move.Geometry, Shift=1, Wrap=False)
shift_list_2 = ShiftList(List=move.Geometry, Shift=-1, Wrap=False)
line = Line(StartPoint=shift_list_2, EndPoint=shift_list)
mirror_2 = Mirror(Geometry=line, Plane=Plane(origin=(0, 0, 0), x=(0, 0, 1), y=(1, 0, 0)))  # -> Geometry, Transform
ggetabsbakemodel = GgETABSBakeModel(ClipSummary=False, NewFile=True, TagReplace=True, Units="kN_m_C")
mirror_3 = Mirror(Geometry=[line, mirror_2.Geometry], Plane=PlaneYZ(0, 0, 0))  # -> Geometry, Transform
ggetabscreateframe = GgETABSCreateFrame(Prop=ggetabscreateframeprop, NodeCL=[line, mirror_2.Geometry, mirror_3.Geometry], Angle=0)
