# Grasshopper definition 0-180604-gsa-intermediate-form-finding-using-normal-properties-for-a-mesh-grillage-use-as-test-examp.gh (Grasshopper 1.0.7)
# plug-ins: BullAnt, ggGHgsa

slider = Slider(12500, range=5..20000)
division = Division(A=slider, B=2)
# Assumes Rhino Document to have Millimetres as Unit
# Jon Mirtschin, Geometry Gym Ltd
# Model Derived from Pete Debney Oasys Webinar
# http://www.oasys-software.com/support/events/webinars/form_finding_with_gsa.shtml
# Requires ggRhinoGSA and BullAnt from http://www.geometrygym.com/downloads
division_2 = Division(A=slider, B=-2)
construct_domain = Domain(DomainStart=division_2, DomainEnd=division)
range = Range(Domain=construct_domain, Steps=Slider(18, range=2..20))
construct_point = PointXYZ(XCoordinate=[division_2, division], YCoordinate=0, ZCoordinate=0)
construct_point_2 = PointXYZ(XCoordinate=0, YCoordinate=[division_2, division], ZCoordinate=0)
construct_point_3 = PointXYZ(XCoordinate=division_2, YCoordinate=range, ZCoordinate=0)
construct_point_4 = PointXYZ(XCoordinate=range, YCoordinate=division, ZCoordinate=0)
construct_point_5 = PointXYZ(XCoordinate=division, YCoordinate=range, ZCoordinate=0)
construct_point_6 = PointXYZ(XCoordinate=range, YCoordinate=division_2, ZCoordinate=0)
ssina = SsiGSANodeAtts(Restraint="RRRFFF", LowNodeID=1)
line = Line(StartPoint=construct_point_3, EndPoint=construct_point_5)
line_2 = Line(StartPoint=construct_point_6, EndPoint=construct_point_4)
ssinode = SsiGSACreateOrFindNode(Location=[construct_point, construct_point_2], Atts=ssina, ToleranceForDetectionOfExistingNodes=-1)
ggcatalogueprofile = GgCatalogueProfile(Region="EuroProfile", Serial="IPE400", Type="EP IPE Beams")
gggsacreate_material = GgGSACreateMaterial(StandardStructureMaterial=0)
panel = Panel("STD R 200. 200.")
sdrcs = SdrCurvesSplitIntersect(Curves=[line_2, line], SplitPoly=False)
gggsacreatesectionprop = GgGSACreateSectionProp(Profile=ggcatalogueprofile, Name="Form Find Beams", Material=gggsacreate_material)
gggsaloadcase = GgGSALoadCase(Name="Form Find Load", ID=1, LoadCaseType="UNDEF", Bridge=False)
gggsabakemodel = GgGSABakeModel(ClipSummary=False, NewFile=True)
gggsacreatebeam = GgGSACreateBeam(Prop=gggsacreatesectionprop, NodeCL=sdrcs, Angle=0)
ssigl = SsiGSAGravityLoad(
    LoadCase=gggsaloadcase,
    StructuralElementList="All",
    XGravityFactor=0,
    YGravityFactor=0,
    ZGravityFactor=Slider(2000, range=1..2000))
integer = Integer(1)
gggsaanalysis_form_find = GgGSAAnalysisFormFind(
    Name="form find task",
    ID=integer,
    SaveSpacerForce=0,
    MaxCycles=10000,
    RelativeResidual=True,
    ForceResidual=0.001,
    MomentResidual=0.001,
    SaveElemForce=False,
    SaveSpacerForce_2=2)
# Form Finding Task, Normal Properties Type
gggsamodel_decompose = GgGSAModelDecompose(ActiveToggle=True)  # -> ModelSummary, Nodes, CurveElements, AreaElements, Material, SectionProperties, AreaProperties, AnalysisCases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
gggsaformfinding = GgGSAFormFinding(Enabled=Toggle(True), NewModel=True, CloseModel=True, FormFindingTask=gggsaanalysis_form_find)  # -> FormFoundNodeLocations, FormFoundPrestressActions, Results
gggsaanalysis_case = GgGSAAnalysisCase(Name="form find analysis case", ID=integer, StructAnalysisTask=gggsaanalysis_form_find, StructLoadCase=gggsaloadcase)
gggsadecomposebeam = GgGSADecomposeBeam(StructureModelBeam=gggsamodel_decompose.CurveElements)  # -> Prop, Axis, NodeA, NodeB, Orientation, Name, Id
list_item = ListItem(List=gggsaformfinding.FormFoundNodeLocations, Index=gggsadecomposebeam.NodeA, Wrap=False)
list_item_2 = ListItem(List=gggsaformfinding.FormFoundNodeLocations, Index=gggsadecomposebeam.NodeB, Wrap=False)
line_3 = Line(StartPoint=list_item, EndPoint=list_item_2)
sdrcnm = SdrNetworkToMesh(Curves=line_3)
